# Grasshopper definition Mallard2Test.ghx (Grasshopper 1.0.7)
# plug-ins: GrasshopperAsyncComponentDemo, jSwan

list_airtable_records = ListAirtableRecords(BaseID="appsj7ZSiHOfUvzXk", AppKey="keyjxzgBUonIj836P", TableName="Table 2", ViewName="Grid view")  # -> ErrorMessage, OutRecords
merge = Merge(
    Data1="Name",
    Data2="Notes",
    Data3="Attachments",
    Data4="Status",
    Data5="multi",
    Data6="check",
    Data7="Collaborators",
    Data8="Date",
    Data9="barcode",
    Data10="Rating",
    Data11="URL",
    Data12="Departments",
    Data13="Notes (from Departments)")
airtable_record_fields = AirtableRecordFields(Records=list_airtable_records.OutRecords, FieldName=graft(merge))
time = Time(airtable_record_fields)
deserialize_json = DeserializeJson(JSON=airtable_record_fields, OutputsLocked=False)
airtable_record_fields_2 = AirtableRecordFields(Records=deserialize_json, FieldName=graft("Company"))
panel = Panel(airtable_record_fields)
